# Grasshopper definition GrasshoperScript.gh (Grasshopper 1.0.8)

loadtype_dropdown = ValueList({"uniform": 0, "central_point": 1, "asymmetric": 2}, selected="uniform")
k_slider = Slider(60, range=0..100)
g_slider = Slider(-0.7, range=-10..10)
n_slider = Slider(60, range=0..200)
reset_toggle = BooleanToggle(False)

pt = ConstructPoint(XCoordinate=0, YCoordinate=0, ZCoordinate=0)
pt_2 = ConstructPoint(XCoordinate=10, YCoordinate=0, ZCoordinate=0)
ln = Line(StartPoint=pt, EndPoint=pt_2)
panel = Panel(ln)
divide = DivideCurve(Curve=ln, Count=n_slider, Kinks=False)  # -> Points, Tangents, Parameters
pline = PolyLine(Vertices=divide.Points, Closed=False)
panel_2 = Panel(divide.Points)
explode = Explode(Curve=pline, Recursive=True)  # -> Segments, Vertices
panel_3 = Panel(explode.Segments)
length_line = LengthLine(Line=explode.Segments, Strength=k_slider)
item = ListItem(List=divide.Points, Index=0, Wrap=True)
item_2 = ListItem(List=divide.Points, Index=-1, Wrap=True)
merge = Merge(Data1=item, Data2=item_2)
anchor = Anchor(Point=merge, Strength=10000)
panel_4 = Panel(anchor)

divider = Slider(2, range=0..50)
divider_2 = Slider(0, range=0..50)
divider_3 = Slider(1, range=0..50)
division = Division(A=n_slider, B=divider)
division_2 = Division(A=n_slider, B=divider)
subtraction = Subtraction(A=division_2, B=divider_3)
dom = ConstructDomain(DomainStart=divider_2, DomainEnd=subtraction)
dom_2 = ConstructDomain(DomainStart=division_2, DomainEnd=n_slider)
panel_5 = Panel(dom)
panel_6 = Panel(dom_2)

Z = UnitZ(Factor=1)
Z_2 = UnitZ(Factor=1)
amp = Amplitude(Vector=Z, Amplitude=g_slider)
Z_3 = UnitZ(Factor=1)
subset = SubList(List=divide.Points, Domain=dom, Wrap=True)  # -> List, Index
subset_2 = SubList(List=divide.Points, Domain=dom_2, Wrap=True)  # -> List, Index
amp_2 = Amplitude(Vector=Z_2, Amplitude=Slider(-0.1, range=-10..10.001))
amp_3 = Amplitude(Vector=Z_3, Amplitude=Slider(-0.5, range=-10..10.001))
item_3 = ListItem(List=divide.Points, Index=division, Wrap=True)
load = Load(Point=subset.List, ForceVector=amp_2, Weighting=1)
load_2 = Load(Point=subset_2.List, ForceVector=amp_3, Weighting=1)
load_3 = Load(Point=divide.Points, ForceVector=amp, Weighting=1)
load_4 = Load(Point=item_3, ForceVector=amp, Weighting=1)
merge_2 = Merge(Data1=load, Data2=load_2)

filter = StreamFilter(Gate=loadtype_dropdown, Stream0=load_3, Stream1=load_4, Stream2=merge_2)
guid_conv = BooleanToggle(True)
merge_3 = Merge(Data1=length_line, Data2=anchor, Data3=filter)
solver = Solver(GoalObjects=merge_3, Reset=reset_toggle, Threshold=1e-15, Tolerance=0.0001, On=guid_conv)  # -> I, V, O
clean = CleanTree(RemoveNulls=True, RemoveInvalid=True, RemoveEmpty=True, Tree=solver.O)
panel_7 = Panel(clean)
end = EndPoints(Curve=clean)  # -> Start, End
merge_4 = Merge(Data1=end.Start, Data2=end.End)
guid_geom = CullDuplicates(Points=merge_4, Tolerance=0.1, CullMode=3)  # -> Points, Indices, Valence
panel_8 = Panel(guid_geom.Points)

panel_9 = Panel("""uniform
central_point
asymmetric""")
item_4 = ListItem(List=panel_9, Index=loadtype_dropdown, Wrap=False)
ipy2 = IronPython2Script(run=Toggle(True))  # -> out, a
# ---------- ipy2: IronPython ----------
doc = ghenv.Component.OnPingDocument()

if run:
    lines = []
    for obj in doc.Objects:
        nickname = obj.NickName
        guid = str(obj.InstanceGuid)
        lines.append("{0}  |  {1}".format(nickname, guid))
    a = "\n".join(sorted(lines))
else:
    a = "Set run=True to list components"
# ---------- end ipy2 ----------
panel_10 = Panel(item_4)
panel_11 = Panel(ipy2.a)

pt_3 = ConstructPoint(
    XCoordinate=Slider(5, range=-10..10.001),
    YCoordinate=Slider(0, range=-10..10.001),
    ZCoordinate=Slider(0, range=-10..10.001))
num = Number(0)
num_2 = Number(360)
py3 = Python3Script(pts=guid_geom.Points, axis_pt=pt_3, half=Toggle(False), start_deg=num, end_deg=num_2)  # -> out, a; inputs pts: list of Point3d, axis_pt: Point3d; disabled
# ---------- py3: Python ----------
import math
import rhinoscriptsyntax as rs
import Rhino.Geometry as rg

def build_profile(pts, half):
    pts_sorted = sorted(pts, key=lambda p: p.X)
    if half:
        crown = max(pts_sorted, key=lambda p: p.Z)
        crown_index = pts_sorted.index(crown)
        profile_pts = pts_sorted[crown_index:]
    else:
        profile_pts = pts_sorted
    return rg.Curve.CreateInterpolatedCurve(profile_pts, 3)

def revolve(crv, axis_pt, start_deg, end_deg):
    ap = rg.Point3d(axis_pt.X, axis_pt.Y, axis_pt.Z)
    axis_line = rg.Line(ap, ap + rg.Vector3d(0, 0, 1))
    revsrf = rg.RevSurface.Create(
        crv, axis_line, math.radians(start_deg), math.radians(end_deg)
    )
    return revsrf.ToBrep()

profile_crv = build_profile(pts, half)
dome = revolve(profile_crv, axis_pt, start_deg, end_deg)

a = dome
b = profile_crv
# ---------- end py3 ----------

py3_2 = Python3Script(run=Toggle(False))  # -> out, a
# ---------- py3_2: Python ----------
import Rhino
import Grasshopper as gh
import scriptcontext as sc
import System
import os
import csv

GUID_N       = "ea491f79-e3e4-44bf-ab5b-71517f8a1cfe"
GUID_G       = "4340db3b-6335-4ca5-b38f-3466c141cf62"
GUID_K       = "34612116-39ac-43b7-a468-2bacc248ec15"
GUID_LOAD    = "2e7cf682-43f0-4d9a-8616-2bd0bf5d61aa"
GUID_RESET   = "3a6bae32-a0ef-47f3-b862-c21874af1a03"
GUID_CONV    = "2e810dd0-d591-49e4-99c8-5931bcd40a1e"
GUID_GEOM    = "f87d8e1a-b58e-432d-9ae1-8cf653c35c15"

# Optional: GUID of the boolean toggle wired into this component's "run" input.
# If you set this, the script will auto-flip it off when the batch finishes,
# preventing an accidental full re-run. Leave as None if you don't have it /
# don't want that behavior (see SAFETY NOTE at bottom of file).
GUID_RUN     = None   # e.g. "xxxxxxxx-xxxx-xxxx-xxxx-xxxxxxxxxxxx"

OUT_FOLDER = r"D:\UT_IT\Conferenca\2026\Architecture\ProgramaticDesign\Computational_Form-Finding_of_Arches\testImages"

loadtypes = [0, 1, 2]
g_values  = [-0.1, -0.3, -0.5, -0.7]
k_values  = [10.0, 25.0, 50.0]
n_values  = [12, 24, 48]

MAX_WAIT_TICKS = 100     # per-combo convergence timeout = MAX_WAIT_TICKS * TICK_MS
SETTLE_TICKS   = 2       # forced idle ticks after reset before trusting convergence
TICK_MS = 150

doc = ghenv.Component.OnPingDocument()
STICKY_KEY = "arch_batch_state"


def find_obj(guid_str):
    target = System.Guid(guid_str)
    for obj in doc.Objects:
        if obj.InstanceGuid == target:
            return obj
    raise Exception("Component not found: " + guid_str)


def set_slider(slider_obj, value):
    slider_obj.SetSliderValue(System.Decimal(value))
    # Mark dirty only -- don't force a solve here. The reset toggle below
    # triggers the single consolidated recompute so all four inputs
    # (loadtype, g, k, n) land in the same solution.
    slider_obj.ExpireSolution(False)

def set_dropdown(list_obj, index):
    # GH_ValueList: selection is per-item (.Selected), there is no SelectedIndex.
    if hasattr(list_obj, 'ListItems'):
        for i, item in enumerate(list_obj.ListItems):
            item.Selected = (i == index)
        list_obj.ExpireSolution(False)
    else:
        # Fallback for a genuine dropdown-style object that does expose SelectedIndex
        list_obj.SelectedIndex = index
        list_obj.ExpireSolution(False)


def get_data_param(obj, output_index=0):
    if hasattr(obj, 'Params') and hasattr(obj.Params, 'Output'):
        return obj.Params.Output[output_index]
    else:
        return obj  # already a param (e.g. Boolean Toggle, Number Slider)


def is_converged():
    conv_comp = find_obj(GUID_CONV)
    conv_output = get_data_param(conv_comp)
    vals = [v.Value for v in conv_output.VolatileData.AllData(True)]
    return bool(vals) and all(vals)


def export_csv(filename):
    geom_comp = find_obj(GUID_GEOM)
    output_param = get_data_param(geom_comp)
    pts = []
    for branch in output_param.VolatileData.Branches:
        for item in branch:
            pt = item.Value
            pts.append((pt.X, pt.Y, pt.Z))
    path = os.path.join(OUT_FOLDER, filename)
    with open(path, "w", newline='') as f:
        writer = csv.writer(f)
        writer.writerow(["x", "y", "z"])
        for p in pts:
            writer.writerow(p)


def build_combos():
    combos = []
    for lt in loadtypes:
        for g_val in g_values:
            for k_val in k_values:
                for n_val in n_values:
                    combos.append((lt, g_val, k_val, n_val))
    return combos


def schedule_next_tick():
    def callback(d):
        ghenv.Component.ExpireSolution(False)
    doc.ScheduleSolution(TICK_MS, callback)


def stop_run_toggle():
    """Best-effort: flip the external run toggle off so the batch can't
    silently restart on the next unrelated recompute."""
    if GUID_RUN is None:
        return
    try:
        run_toggle = find_obj(GUID_RUN)
        run_toggle.Value = False
        run_toggle.ExpireSolution(True)
    except Exception:
        pass


# --- Start a new batch on the rising edge of 'run' ---
# 'batch_done' guards against re-triggering while `run` stays True with no
# GUID_RUN available to flip it off programmatically (see SAFETY NOTE below).
if run and STICKY_KEY not in sc.sticky and not sc.sticky.get(STICKY_KEY + "_done", False):
    sc.sticky[STICKY_KEY] = {
        'combos': build_combos(),
        'idx': 0,
        'phase': 'reset_on',
        'wait_ticks': 0,
        'settle_ticks': 0,
        'log': []
    }
    sc.sticky[STICKY_KEY + "_done"] = False

if not run:
    # Rising edge required again next time -- clear the done-latch once the
    # user manually drops `run` back to False.
    sc.sticky[STICKY_KEY + "_done"] = False

state = sc.sticky.get(STICKY_KEY, None)
a = "idle"

if state is not None:
    combos = state['combos']
    idx = state['idx']

    if idx >= len(combos):
        a = "BATCH COMPLETE -- {0} runs".format(len(combos))
        for r in state['log']:
            print(r)
        if STICKY_KEY in sc.sticky:
            del sc.sticky[STICKY_KEY]
        sc.sticky[STICKY_KEY + "_done"] = True
        stop_run_toggle()
    else:
        lt, g_val, k_val, n_val = combos[idx]
        phase = state['phase']
        sc.sticky[STICKY_KEY] = state

        if phase == 'reset_on':
            set_dropdown(find_obj(GUID_LOAD), lt)
            set_slider(find_obj(GUID_G), g_val)
            set_slider(find_obj(GUID_K), k_val)
            set_slider(find_obj(GUID_N), n_val)
            reset_toggle = find_obj(GUID_RESET)
            reset_toggle.Value = True
            reset_toggle.ExpireSolution(True)   # single consolidated solve
            state['phase'] = 'reset_off'
            a = "combo {0}/{1}: reset ON".format(idx + 1, len(combos))
            schedule_next_tick()

        elif phase == 'reset_off':
            reset_toggle = find_obj(GUID_RESET)
            reset_toggle.Value = False
            reset_toggle.ExpireSolution(True)
            state['phase'] = 'settle'
            state['settle_ticks'] = 0
            a = "combo {0}/{1}: settling...".format(idx + 1, len(combos))
            schedule_next_tick()

        elif phase == 'settle':
            # Force a few idle ticks so the solver has actually run at least
            # once on the *new* inputs before we start trusting is_converged().
            # Prevents reading a stale True carried over from the previous combo.
            state['settle_ticks'] += 1
            if state['settle_ticks'] >= SETTLE_TICKS:
                state['phase'] = 'check_converge'
                state['wait_ticks'] = 0
            a = "combo {0}/{1}: settling ({2}/{3})".format(
                idx + 1, len(combos), state['settle_ticks'], SETTLE_TICKS)
            schedule_next_tick()

        elif phase == 'check_converge':
            if is_converged():
                fname = "arch_run{0}_{1}_g{2}_k{3}.csv".format(
                    n_val, lt, round(g_val, 3), round(k_val, 3))
                export_csv(fname)
                state['log'].append((fname, "OK"))
                state['idx'] += 1
                state['phase'] = 'reset_on'
                a = "combo {0}/{1}: CONVERGED, exported".format(idx + 1, len(combos))
            else:
                state['wait_ticks'] += 1
                if state['wait_ticks'] > MAX_WAIT_TICKS:
                    fname = "arch_run{0}_{1}_g{2}_k{3}.csv".format(
                        n_val, lt, round(g_val, 3), round(k_val, 3))
                    state['log'].append((fname, "DID NOT CONVERGE"))
                    state['idx'] += 1
                    state['phase'] = 'reset_on'
                    a = "combo {0}/{1}: TIMED OUT".format(idx + 1, len(combos))
                else:
                    a = "combo {0}/{1}: waiting ({2}/{3})".format(
                        idx + 1, len(combos), state['wait_ticks'], MAX_WAIT_TICKS)
            schedule_next_tick()
# ---------- end py3_2 ----------

py3_3 = Python3Script(N=n_slider, loadtype=loadtype_dropdown, k_val=k_slider, g_val=g_slider, pts=guid_geom.Points)  # -> out, a; inputs N: Double, loadtype: String, k_val: Double, g_val: Double, pts: list of Point3d; disabled
# ---------- py3_3: Python ----------
import csv
import os
import rhinoscriptsyntax as rs

folder = r"D:\UT_IT\Conferenca\2026\Architecture\ProgramaticDesign\Computational_Form-Finding_of_Arches\testImages"

filename = "arch_run{N}_{loadtype}_g{g}_k{k}.csv".format(
    N=N,
    loadtype=loadtype, 
    g=round(g_val, 3),
    k=round(k_val, 3)
)
path = os.path.join(folder, filename)

with open(path, mode='w', newline='') as f:
    writer = csv.writer(f)
    writer.writerow(["x", "y", "z"])
    for p in pts:
        pt = rs.coerce3dpoint(p)
        writer.writerow([pt.X, pt.Y, pt.Z])

a = "Done: " + str(len(pts)) + " points written to " + filename
# ---------- end py3_3 ----------

intcrv = Interpolate(Vertices=guid_geom.Points, Degree=3, Periodic=False, KnotStyle=1)  # -> Curve, Length, Domain
xy = XYPlane(Origin=Point(0, 0, 0))
rotate = Rotate(Geometry=intcrv.Curve, Angle=Slider(1.57, range=0..6.28), Plane=xy)  # -> Geometry, Transform
Y = UnitY(Factor=1)
X = UnitX(Factor=1)
amp_4 = Amplitude(Vector=Y, Amplitude=Slider(10, range=0..30))
amp_5 = Amplitude(Vector=X, Amplitude=Slider(10, range=0..30))
panel_12 = Panel(amp_5)
neg = Negative(Value=amp_4)
panel_13 = Panel(amp_4)
neg_2 = Negative(Value=amp_5)
panel_14 = Panel(neg)
extr = Extrude(Base=rotate.Geometry, Direction=amp_5)
panel_15 = Panel(neg_2)
extr_2 = Extrude(Base=intcrv.Curve, Direction=amp_4)
bbx = BrepBrep(BrepA=extr_2, BrepB=extr)  # -> Curves, Points; disabled
extr_3 = Extrude(Base=intcrv.Curve, Direction=neg)
extr_4 = Extrude(Base=rotate.Geometry, Direction=neg_2)
number_slider = Slider(1, range=0..20)
split = SplitBrep(Brep=extr, Cutter=extr_2)
split_2 = SplitBrep(Brep=extr_2, Cutter=extr)
number_slider_2 = Slider(-5, range=-20..20)
item_5 = ListItem(List=split_2, Index=Slider(2, range=0..20), Wrap=True)
item_6 = ListItem(List=split, Index=Slider(2, range=0..20), Wrap=True)
vec = VectorXYZ(XComponent=number_slider_2, YComponent=number_slider_2, ZComponent=0)  # -> Vector, Length
vec_2 = VectorXYZ(XComponent=number_slider_2, YComponent=Slider(-5, range=-20..20), ZComponent=0)  # -> Vector, Length
item_7 = ListItem(List=split, Index=Slider(0, range=0..20), Wrap=True)
item_8 = ListItem(List=split_2, Index=Slider(1, range=0..20), Wrap=True)
item_9 = ListItem(List=split, Index=Slider(1, range=0..20), Wrap=True)
vec_3 = VectorXYZ(XComponent=Slider(0, range=-20..20), YComponent=Slider(-10, range=-20..20), ZComponent=0)  # -> Vector, Length
move = Move(Geometry=item_5, Motion=vec.Vector)  # -> Geometry, Transform
xz = XZPlane(Origin=Point(0, 0, 0))
yz = YZPlane(Origin=Point(0, 0, 0))
move_2 = Move(Geometry=item_6, Motion=vec_2.Vector)  # -> Geometry, Transform
xz_2 = XZPlane(Origin=Point(0, 0, 0))
move_3 = Move(Geometry=item_8, Motion=vec_3.Vector)  # -> Geometry, Transform
mirror = Mirror(Geometry=move.Geometry, Plane=xz)  # -> Geometry, Transform
mirror_2 = Mirror(Geometry=move_2.Geometry, Plane=yz)  # -> Geometry, Transform
mirror_3 = Mirror(Geometry=move_3.Geometry, Plane=xz_2)  # -> Geometry, Transform
merge_5 = Merge(Data1=mirror_3.Geometry, Data2=item_8, Data3=item_7, Data4=item_9)
merge_6 = Merge(Data1=move.Geometry, Data2=mirror.Geometry, Data3=move_2.Geometry, Data4=mirror_2.Geometry)
filter_2 = StreamFilter(Gate=loadtype_dropdown, Stream0=merge_6, Stream1=merge_6, Stream2=merge_5)
xy_2 = XYPlane(Origin=Point(0, 0, 0))
mirror_4 = Mirror(Geometry=filter_2, Plane=xy_2)  # -> Geometry, Transform
X_2 = UnitX(Factor=Slider(10, range=0..20))
arrlinear = LinearArray(Geometry=mirror_4.Geometry, Direction=X_2, Count=Slider(7, range=0..20))  # -> Geometry, Transform
Y_2 = UnitY(Factor=Slider(10, range=0..20))
arrlinear_2 = LinearArray(Geometry=arrlinear.Geometry, Direction=Y_2, Count=Slider(7, range=0..20))  # -> Geometry, Transform
